# Grasshopper definition Population Density_018.01.2.gh (Grasshopper 0.9.76)

# ---- group: Point Array
number_slider = Slider(180, range=0..200)
number_slider_2 = Slider(150, range=0..200)
pt = ConstructPoint(XCoordinate=Slider(-30, range=-30..100), YCoordinate=Slider(10, range=0..100), ZCoordinate=0)
rectangle = Rectangle(Plane=PlaneXY(0, 0, 0), XSize=Slider(10, range=0..10), YSize=Slider(9, range=0..10), Radius=0)  # -> Rectangle, Length
arrrec = RectangularArray(Geometry=pt, Cell=rectangle.Rectangle, XCount=number_slider, YCount=number_slider_2)  # -> Geometry, Transform

# ---- group: X dependent
subtraction = Subtraction(A=number_slider, B="1")

# ---- group: Y dependent
subtraction_2 = Subtraction(A=number_slider_2, B="1")

# ---- group: Partition List
partition = PartitionList(List=arrrec.Geometry, Size="180")

# ---- group: Flip Data Baskets
flip = FlipMatrix(Data=partition)

# ---- group: Group 2
cull_i = CullIndex(List=flip, Indices=0, Wrap=True)

# ---- group: Group 1
cull_i_2 = CullIndex(List=flip, Indices=subtraction_2, Wrap=True)

# ----
flip_2 = FlipMatrix(Data=cull_i)

flip_3 = FlipMatrix(Data=cull_i_2)

# ---- group: Points B
cull_i_3 = CullIndex(List=flip_3, Indices=0, Wrap=True)

# ---- group: Points C
cull_i_4 = CullIndex(List=flip_2, Indices=0, Wrap=True)

# ---- group: Points D
cull_i_5 = CullIndex(List=flip_2, Indices=subtraction, Wrap=True)

# ---- group: Points A
cull_i_6 = CullIndex(List=flip_3, Indices=subtraction, Wrap=True)

# ---- group: AB Line
ln = Line(StartPoint=cull_i_6, EndPoint=cull_i_3)

# ---- group: BC Line
ln_2 = Line(StartPoint=cull_i_3, EndPoint=cull_i_4)

# ---- group: CD Line
ln_3 = Line(StartPoint=cull_i_4, EndPoint=cull_i_5)

# ---- group: DA Line
ln_4 = Line(StartPoint=cull_i_5, EndPoint=cull_i_6)

# ----
join = JoinCurves(Curves=[ln_4, ln_3, ln_2, ln], Preserve=False)

# ---- group: Base curves
crv = Curve(<curve referenced from the Rhino model>)
crv_2 = Curve(<curve referenced from the Rhino model>)
crv_3 = Curve(<curve referenced from the Rhino model>)

crv_4 = Curve([<curve referenced from the Rhino model> x8])
crv_5 = Curve(<curve referenced from the Rhino model>)
crv_6 = Curve(<curve referenced from the Rhino model>)

# ---- group: Grouping Scale Factor
area = Area(Geometry=join)  # -> Area, Centroid
scale = Scale(Geometry=join, Center=area.Centroid, Factor=Slider(1, range=0..30))  # -> Geometry, Transform

# ---- group: Base curves
crv_7 = Curve([<curve referenced from the Rhino model> x7])
crv_8 = Curve([<curve referenced from the Rhino model> x10])
crv_9 = Curve([<curve referenced from the Rhino model> x5])

crv_10 = Curve(<curve referenced from the Rhino model>)
crv_11 = Curve([<curve referenced from the Rhino model> x10])
crv_12 = Curve([<curve referenced from the Rhino model> x10])
crv_13 = Curve([<curve referenced from the Rhino model> x7])

# ----
crv_14 = Curve([<curve referenced from the Rhino model> x20])
crv_15 = Curve([<curve referenced from the Rhino model> x10])
crv_16 = Curve([<curve referenced from the Rhino model> x10])

# ---- group: Base curves
crv_17 = Curve([<curve referenced from the Rhino model> x2])
crv_18 = Curve(<curve referenced from the Rhino model>)
crv_19 = Curve([<curve referenced from the Rhino model> x7])
crv_20 = Curve([<curve referenced from the Rhino model> x3])
crv_21 = Curve([<curve referenced from the Rhino model> x2])

# ---- group: Bounding Curve / Point in curves
incurves = PointInCurves(Point=area.Centroid, Curves=[crv, crv_2, crv_3])  # -> Relationship, Index, Point

# ---- group: Base curves
crv_22 = Curve([<curve referenced from the Rhino model> x26])
crv_23 = Curve(<curve referenced from the Rhino model>)
crv_24 = Curve([<curve referenced from the Rhino model> x9])

crv_25 = Curve([<curve referenced from the Rhino model> x17])
crv_26 = Curve(<curve referenced from the Rhino model>)
crv_27 = Curve(<curve referenced from the Rhino model>)

crv_28 = Curve(<curve referenced from the Rhino model>)
crv_29 = Curve([<curve referenced from the Rhino model> x5])
crv_30 = Curve([<curve referenced from the Rhino model> x11])

crv_31 = Curve([<curve referenced from the Rhino model> x5])
crv_32 = Curve([<curve referenced from the Rhino model> x13])
crv_33 = Curve([<curve referenced from the Rhino model> x13])

crv_34 = Curve([<curve referenced from the Rhino model> x13])
crv_35 = Curve([<curve referenced from the Rhino model> x9])
crv_36 = Curve([<curve referenced from the Rhino model> x12])

crv_37 = Curve([<curve referenced from the Rhino model> x13])
crv_38 = Curve([<curve referenced from the Rhino model> x9])
crv_39 = Curve([<curve referenced from the Rhino model> x20])
crv_40 = Curve([<curve referenced from the Rhino model> x22])

crv_41 = Curve([<curve referenced from the Rhino model> x9])
crv_42 = Curve([<curve referenced from the Rhino model> x15])
crv_43 = Curve([<curve referenced from the Rhino model> x6])

# ---- group: Bounding Curve
larger = LargerThan(FirstNumber=incurves.Relationship, SecondNumber="0")  # -> LargerThan, OrEqualTo
dispatch = Dispatch(List=join, DispatchPattern=larger.LargerThan)  # -> ListA, ListB
crv_44 = Curve(dispatch.ListA)
crv_45 = Curve(dispatch.ListB)
area_2 = Area(Geometry=crv_44)  # -> Area, Centroid

# ---- group: Vendors / Polygon D
incurves_2 = PointInCurves(Point=area_2.Centroid, Curves=[crv_4, crv_5, crv_6])  # -> Relationship, Index, Point
larger_2 = LargerThan(FirstNumber=incurves_2.Relationship, SecondNumber="0")  # -> LargerThan, OrEqualTo

# ---- group: Polygon B
incurves_3 = PointInCurves(Point=area_2.Centroid, Curves=[crv_15, crv_16, crv_14])  # -> Relationship, Index, Point
larger_3 = LargerThan(FirstNumber=incurves_3.Relationship, SecondNumber="0")  # -> LargerThan, OrEqualTo

# ---- group: Commercial / Polygon B
incurves_4 = PointInCurves(Point=area_2.Centroid, Curves=[crv_7, crv_8, crv_9])  # -> Relationship, Index, Point
larger_4 = LargerThan(FirstNumber=incurves_4.Relationship, SecondNumber="0")  # -> LargerThan, OrEqualTo

# ---- group: Open Spaces / Polygon C
incurves_5 = PointInCurves(Point=area_2.Centroid, Curves=[crv_21, crv_20, crv_19, crv_17, crv_18])  # -> Relationship, Index, Point
larger_5 = LargerThan(FirstNumber=incurves_5.Relationship, SecondNumber="0")  # -> LargerThan, OrEqualTo

# ---- group: Commercial / Polygon B
incurves_6 = PointInCurves(Point=area_2.Centroid, Curves=[crv_37, crv_11, crv_13, crv_12, crv_40, crv_39, crv_38, crv_10])  # -> Relationship, Index, Point
larger_6 = LargerThan(FirstNumber=incurves_6.Relationship, SecondNumber="0")  # -> LargerThan, OrEqualTo

# ---- group: Base curves
crv_46 = Curve([<curve referenced from the Rhino model> x22])
crv_47 = Curve([<curve referenced from the Rhino model> x34])
crv_48 = Curve([<curve referenced from the Rhino model> x19])

crv_49 = Curve([<curve referenced from the Rhino model> x8])
crv_50 = Curve([<curve referenced from the Rhino model> x5])
crv_51 = Curve(<curve referenced from the Rhino model>)

# ---- group: Resident Population / Polygon A
incurves_7 = PointInCurves(Point=area_2.Centroid, Curves=[crv_25, crv_26, crv_27, crv_34, crv_35, crv_36, crv_49, crv_50, crv_51])  # -> Relationship, Index, Point
larger_7 = LargerThan(FirstNumber=incurves_7.Relationship, SecondNumber="0")  # -> LargerThan, OrEqualTo

# ---- group: Base curves
crv_52 = Curve([<curve referenced from the Rhino model> x8])
crv_53 = Curve([<curve referenced from the Rhino model> x4])
crv_54 = Curve(<curve referenced from the Rhino model>)

# ---- group: Resident Population / Polygon A
incurves_8 = PointInCurves(Point=area_2.Centroid, Curves=[crv_28, crv_29, crv_30, crv_41, crv_42, crv_43, crv_52, crv_53, crv_54])  # -> Relationship, Index, Point
larger_8 = LargerThan(FirstNumber=incurves_8.Relationship, SecondNumber="0")  # -> LargerThan, OrEqualTo

# ---- group: Base curves
crv_55 = Curve([<curve referenced from the Rhino model> x10])
crv_56 = Curve([<curve referenced from the Rhino model> x24])
crv_57 = Curve([<curve referenced from the Rhino model> x4])

# ---- group: Resident Population / Polygon A
incurves_9 = PointInCurves(
    Point=area_2.Centroid,
    Curves=[crv_31, crv_22, crv_23, crv_24, crv_32, crv_33, crv_46, crv_47, crv_48, crv_57, crv_56, crv_55])  # -> Relationship, Index, Point
larger_9 = LargerThan(FirstNumber=incurves_9.Relationship, SecondNumber="0")  # -> LargerThan, OrEqualTo

# ---- group: Commercial
dispatch_2 = Dispatch(List=crv_44, DispatchPattern=larger_4.LargerThan)  # -> ListA, ListB
crv_58 = Curve(dispatch_2.ListA)

# ---- group: Resident Population
dispatch_3 = Dispatch(List=crv_44, DispatchPattern=larger_9.LargerThan)  # -> ListA, ListB
crv_59 = Curve(dispatch_3.ListA)

dispatch_4 = Dispatch(List=crv_44, DispatchPattern=larger_8.LargerThan)  # -> ListA, ListB
crv_60 = Curve(dispatch_4.ListA)

dispatch_5 = Dispatch(List=crv_44, DispatchPattern=larger_7.LargerThan)  # -> ListA, ListB
crv_61 = Curve(dispatch_5.ListA)

# ---- group: Vendors
dispatch_6 = Dispatch(List=crv_44, DispatchPattern=larger_2.LargerThan)  # -> ListA, ListB
crv_62 = Curve(dispatch_6.ListA)

# ---- group: Open Spaces
dispatch_7 = Dispatch(List=crv_44, DispatchPattern=larger_5.LargerThan)  # -> ListA, ListB
crv_63 = Curve(dispatch_7.ListA)

# ----
dispatch_8 = Dispatch(List=crv_44, DispatchPattern=larger_3.LargerThan)  # -> ListA, ListB
crv_64 = Curve(dispatch_8.ListA)

# ---- group: Commercial
dispatch_9 = Dispatch(List=crv_44, DispatchPattern=larger_6.LargerThan)  # -> ListA, ListB
crv_65 = Curve(dispatch_9.ListA)

# ---- group: Resident Population
boundary = BoundarySurfaces(Edges=crv_59)

boundary_2 = BoundarySurfaces(Edges=crv_60)

boundary_3 = BoundarySurfaces(Edges=crv_61)

# ---- group: Commercial
boundary_4 = BoundarySurfaces(Edges=crv_58)

# ---- group: Vendors
boundary_5 = BoundarySurfaces(Edges=crv_62)

# ----
boundary_6 = BoundarySurfaces(Edges=crv_64)

# ---- group: Open Spaces
boundary_7 = BoundarySurfaces(Edges=crv_63)

# ---- group: Commercial
boundary_8 = BoundarySurfaces(Edges=crv_65)

# ----
mesh = MeshBrep(
    Brep=boundary,
    Settings={GridMaxCount=0, GridMinCount=16, JaggedSeams=False, MaxEdgeLength=0, MinEdgeLength=0.0001, MinTolerance=0, Refine=True, RefineAngle=0, RelativeTolerance=0.65, SimplePlanes=True, Tolerance=0})
mjoin = MeshJoin(Meshes=mesh)
graft = GraftTree(Tree=mesh, IncludeEmptyLists=True, IncludeNullItems=True)
area_3 = Area(Geometry=mesh)  # -> Area, Centroid
area_4 = Area(Geometry=mjoin)  # -> Area, Centroid
dist = Distance(PointA=area_3.Centroid, PointB=area_4.Centroid)
bnd = Bounds(Numbers=dist)
dedomain = DeconstructDomain(Domain=bnd)  # -> Start, End
gradient = Gradient(LowerLimit=dedomain.Start, UpperLimit=dedomain.End, Parameter=dist, stops=[0: RGB(234, 38, 0), 1: RGB(254, 244, 84)])
graft_2 = GraftTree(Tree=gradient, IncludeEmptyLists=True, IncludeNullItems=True)
mcol = MeshColours(Mesh=graft, Colours=graft_2)

mesh_2 = MeshBrep(
    Brep=boundary_2,
    Settings={GridMaxCount=0, GridMinCount=16, JaggedSeams=False, MaxEdgeLength=0, MinEdgeLength=0.0001, MinTolerance=0, Refine=True, RefineAngle=0, RelativeTolerance=0.65, SimplePlanes=True, Tolerance=0})
mjoin_2 = MeshJoin(Meshes=mesh_2)
area_5 = Area(Geometry=mesh_2)  # -> Area, Centroid
graft_3 = GraftTree(Tree=mesh_2, IncludeEmptyLists=True, IncludeNullItems=True)
area_6 = Area(Geometry=mjoin_2)  # -> Area, Centroid
dist_2 = Distance(PointA=area_5.Centroid, PointB=area_6.Centroid)
bnd_2 = Bounds(Numbers=dist_2)
dedomain_2 = DeconstructDomain(Domain=bnd_2)  # -> Start, End
gradient_2 = Gradient(
    LowerLimit=dedomain_2.Start,
    UpperLimit=dedomain_2.End,
    Parameter=dist_2,
    stops=[0: RGB(234, 38, 0), 1: RGB(254, 244, 84)])
graft_4 = GraftTree(Tree=gradient_2, IncludeEmptyLists=True, IncludeNullItems=True)
mcol_2 = MeshColours(Mesh=graft_3, Colours=graft_4)

mesh_3 = MeshBrep(
    Brep=boundary_3,
    Settings={GridMaxCount=0, GridMinCount=16, JaggedSeams=False, MaxEdgeLength=0, MinEdgeLength=0.0001, MinTolerance=0, Refine=True, RefineAngle=0, RelativeTolerance=0.65, SimplePlanes=True, Tolerance=0})
mjoin_3 = MeshJoin(Meshes=mesh_3)
area_7 = Area(Geometry=mesh_3)  # -> Area, Centroid
graft_5 = GraftTree(Tree=mesh_3, IncludeEmptyLists=True, IncludeNullItems=True)
area_8 = Area(Geometry=mjoin_3)  # -> Area, Centroid
dist_3 = Distance(PointA=area_7.Centroid, PointB=area_8.Centroid)
bnd_3 = Bounds(Numbers=dist_3)
dedomain_3 = DeconstructDomain(Domain=bnd_3)  # -> Start, End
gradient_3 = Gradient(
    LowerLimit=dedomain_3.Start,
    UpperLimit=dedomain_3.End,
    Parameter=dist_3,
    stops=[0: RGB(234, 38, 0), 1: RGB(254, 244, 84)])
graft_6 = GraftTree(Tree=gradient_3, IncludeEmptyLists=True, IncludeNullItems=True)
mcol_3 = MeshColours(Mesh=graft_5, Colours=graft_6)

mesh_4 = MeshBrep(
    Brep=boundary_4,
    Settings={GridMaxCount=0, GridMinCount=16, JaggedSeams=False, MaxEdgeLength=0, MinEdgeLength=0.0001, MinTolerance=0, Refine=True, RefineAngle=0, RelativeTolerance=0.65, SimplePlanes=True, Tolerance=0})
mjoin_4 = MeshJoin(Meshes=mesh_4)
graft_7 = GraftTree(Tree=mesh_4, IncludeEmptyLists=True, IncludeNullItems=True)
area_9 = Area(Geometry=mesh_4)  # -> Area, Centroid
area_10 = Area(Geometry=mjoin_4)  # -> Area, Centroid
dist_4 = Distance(PointA=area_9.Centroid, PointB=area_10.Centroid)
bnd_4 = Bounds(Numbers=dist_4)
dedomain_4 = DeconstructDomain(Domain=bnd_4)  # -> Start, End
gradient_4 = Gradient(
    LowerLimit=dedomain_4.Start,
    UpperLimit=dedomain_4.End,
    Parameter=dist_4,
    stops=[0: RGB(39, 72, 161), 1: RGB(1, 192, 229)])
graft_8 = GraftTree(Tree=gradient_4, IncludeEmptyLists=True, IncludeNullItems=True)
mcol_4 = MeshColours(Mesh=graft_7, Colours=graft_8)

mesh_5 = MeshBrep(
    Brep=boundary_6,
    Settings={GridMaxCount=0, GridMinCount=16, JaggedSeams=False, MaxEdgeLength=0, MinEdgeLength=0.0001, MinTolerance=0, Refine=True, RefineAngle=0, RelativeTolerance=0.65, SimplePlanes=True, Tolerance=0})
mjoin_5 = MeshJoin(Meshes=mesh_5)
graft_9 = GraftTree(Tree=mesh_5, IncludeEmptyLists=True, IncludeNullItems=True)
area_11 = Area(Geometry=mesh_5)  # -> Area, Centroid
area_12 = Area(Geometry=mjoin_5)  # -> Area, Centroid
dist_5 = Distance(PointA=area_11.Centroid, PointB=area_12.Centroid)
bnd_5 = Bounds(Numbers=dist_5)
dedomain_5 = DeconstructDomain(Domain=bnd_5)  # -> Start, End
gradient_5 = Gradient(
    LowerLimit=dedomain_5.Start,
    UpperLimit=dedomain_5.End,
    Parameter=dist_5,
    stops=[0.049: RGB(39, 72, 161), 1: RGB(1, 192, 229)])
graft_10 = GraftTree(Tree=gradient_5, IncludeEmptyLists=True, IncludeNullItems=True)
mcol_5 = MeshColours(Mesh=graft_9, Colours=graft_10)

mesh_6 = MeshBrep(
    Brep=boundary_8,
    Settings={GridMaxCount=0, GridMinCount=16, JaggedSeams=False, MaxEdgeLength=0, MinEdgeLength=0.0001, MinTolerance=0, Refine=True, RefineAngle=0, RelativeTolerance=0.65, SimplePlanes=True, Tolerance=0})
mjoin_6 = MeshJoin(Meshes=mesh_6)
graft_11 = GraftTree(Tree=mesh_6, IncludeEmptyLists=True, IncludeNullItems=True)
area_13 = Area(Geometry=mesh_6)  # -> Area, Centroid
area_14 = Area(Geometry=mjoin_6)  # -> Area, Centroid
dist_6 = Distance(PointA=area_13.Centroid, PointB=area_14.Centroid)
bnd_6 = Bounds(Numbers=dist_6)
dedomain_6 = DeconstructDomain(Domain=bnd_6)  # -> Start, End
gradient_6 = Gradient(
    LowerLimit=dedomain_6.Start,
    UpperLimit=dedomain_6.End,
    Parameter=dist_6,
    stops=[0: RGB(39, 72, 161), 1: RGB(1, 192, 229)])
graft_12 = GraftTree(Tree=gradient_6, IncludeEmptyLists=True, IncludeNullItems=True)
mcol_6 = MeshColours(Mesh=graft_11, Colours=graft_12)

mesh_7 = MeshBrep(
    Brep=boundary_7,
    Settings={GridMaxCount=0, GridMinCount=16, JaggedSeams=False, MaxEdgeLength=0, MinEdgeLength=0.0001, MinTolerance=0, Refine=True, RefineAngle=0, RelativeTolerance=0.65, SimplePlanes=True, Tolerance=0})
mjoin_7 = MeshJoin(Meshes=mesh_7)
graft_13 = GraftTree(Tree=mesh_7, IncludeEmptyLists=True, IncludeNullItems=True)
area_15 = Area(Geometry=mesh_7)  # -> Area, Centroid
area_16 = Area(Geometry=mjoin_7)  # -> Area, Centroid
dist_7 = Distance(PointA=area_15.Centroid, PointB=area_16.Centroid)
bnd_7 = Bounds(Numbers=dist_7)
dedomain_7 = DeconstructDomain(Domain=bnd_7)  # -> Start, End
gradient_7 = Gradient(
    LowerLimit=dedomain_7.Start,
    UpperLimit=dedomain_7.End,
    Parameter=dist_7,
    stops=[0.376: RGB(255, 255, 255), 0.99: RGB(1, 192, 229), 1: RGB(39, 72, 161)])
graft_14 = GraftTree(Tree=gradient_7, IncludeEmptyLists=True, IncludeNullItems=True)
mcol_7 = MeshColours(Mesh=graft_13, Colours=graft_14)

mesh_8 = MeshBrep(
    Brep=boundary_5,
    Settings={GridMaxCount=0, GridMinCount=16, JaggedSeams=False, MaxEdgeLength=0, MinEdgeLength=0.0001, MinTolerance=0, Refine=True, RefineAngle=0, RelativeTolerance=0.65, SimplePlanes=True, Tolerance=0})
mjoin_8 = MeshJoin(Meshes=mesh_8)
graft_15 = GraftTree(Tree=mesh_8, IncludeEmptyLists=True, IncludeNullItems=True)
area_17 = Area(Geometry=mesh_8)  # -> Area, Centroid
area_18 = Area(Geometry=mjoin_8)  # -> Area, Centroid
dist_8 = Distance(PointA=area_17.Centroid, PointB=area_18.Centroid)
bnd_8 = Bounds(Numbers=dist_8)
dedomain_8 = DeconstructDomain(Domain=bnd_8)  # -> Start, End
gradient_8 = Gradient(
    LowerLimit=dedomain_8.Start,
    UpperLimit=dedomain_8.End,
    Parameter=dist_8,
    stops=[0.049: RGB(39, 72, 161), 1: RGB(1, 192, 229)])
graft_16 = GraftTree(Tree=gradient_8, IncludeEmptyLists=True, IncludeNullItems=True)
mcol_8 = MeshColours(Mesh=graft_15, Colours=graft_16)

join_2 = JoinCurves(Curves=[crv, crv_3], Preserve=False)
boundary_9 = BoundarySurfaces(Edges=join_2)
Z = UnitZ(Factor=Slider(-40, range=-50..50))
extr = Extrude(Base=boundary_9, Direction=Z)

join_3 = JoinCurves(Curves=crv_2, Preserve=False)
boundary_10 = BoundarySurfaces(Edges=join_3)
Z_2 = UnitZ(Factor=Slider(10, range=-50..50))
extr_2 = Extrude(Base=boundary_10, Direction=Z_2)

flatten = FlattenTree(Tree=dedomain_2.Start, Path="{0}")
bnd_9 = Bounds(Numbers=flatten)
panel = Panel(bnd_9)

flatten_2 = FlattenTree(Tree=dedomain.Start, Path="{0}")
bnd_10 = Bounds(Numbers=flatten_2)
panel_2 = Panel(bnd_10)

flatten_3 = FlattenTree(Tree=dedomain_3.Start, Path="{0}")
bnd_11 = Bounds(Numbers=flatten_3)
panel_3 = Panel(bnd_11)

flatten_4 = FlattenTree(Tree=dedomain_4.Start, Path="{0}")
bnd_12 = Bounds(Numbers=flatten_4)
panel_4 = Panel(bnd_12)

flatten_5 = FlattenTree(Tree=dedomain_6.Start, Path="{0}")
bnd_13 = Bounds(Numbers=flatten_5)
panel_5 = Panel(bnd_13)

flatten_6 = FlattenTree(Tree=dedomain_5.Start, Path="{0}")
bnd_14 = Bounds(Numbers=flatten_6)
panel_6 = Panel(bnd_14)

flatten_7 = FlattenTree(Tree=dedomain_7.Start, Path="{0}")
bnd_15 = Bounds(Numbers=flatten_7)
panel_7 = Panel(bnd_15)

flatten_8 = FlattenTree(Tree=dedomain_8.Start, Path="{0}")
bnd_16 = Bounds(Numbers=flatten_8)
panel_8 = Panel(bnd_16)

mesh_9 = MeshBrep(
    Brep=[extr_2, extr],
    Settings={GridMaxCount=0, GridMinCount=16, JaggedSeams=False, MaxEdgeLength=0, MinEdgeLength=0.0001, MinTolerance=0, Refine=True, RefineAngle=0, RelativeTolerance=0.65, SimplePlanes=True, Tolerance=0})
rgb = ColourRGB(
    Alpha=Slider(211, range=0..1000),
    Red=Slider(211, range=0..1000),
    Green=Slider(211, range=0..1000),
    Blue=Slider(211, range=0..1000))
mcol_9 = MeshColours(Mesh=mesh_9, Colours=rgb)

dom = ConstructDomain(DomainStart=Slider(40, range=0..100), DomainEnd=Slider(50, range=0..100))
remap = RemapNumbers(Value=dedomain.Start, Source=panel_2, Target=dom)  # -> Mapped, Clipped
Z_3 = UnitZ(Factor=remap.Mapped)
extr_3 = Extrude(Base=boundary, Direction=Z_3)
mesh_10 = MeshBrep(
    Brep=extr_3,
    Settings={GridMaxCount=0, GridMinCount=16, JaggedSeams=False, MaxEdgeLength=0, MinEdgeLength=0.0001, MinTolerance=0, Refine=True, RefineAngle=0, RelativeTolerance=0.65, SimplePlanes=True, Tolerance=0})
mcol_10 = MeshColours(Mesh=mesh_10, Colours=graft_2)

dom_2 = ConstructDomain(DomainStart=Slider(60, range=0..100), DomainEnd=Slider(80, range=0..100))
remap_2 = RemapNumbers(Value=dedomain_2.Start, Source=panel, Target=dom_2)  # -> Mapped, Clipped
Z_4 = UnitZ(Factor=remap_2.Mapped)
extr_4 = Extrude(Base=boundary_2, Direction=Z_4)
mesh_11 = MeshBrep(
    Brep=extr_4,
    Settings={GridMaxCount=0, GridMinCount=16, JaggedSeams=False, MaxEdgeLength=0, MinEdgeLength=0.0001, MinTolerance=0, Refine=True, RefineAngle=0, RelativeTolerance=0.65, SimplePlanes=True, Tolerance=0})
mcol_11 = MeshColours(Mesh=mesh_11, Colours=graft_4)

dom_3 = ConstructDomain(DomainStart=Slider(80, range=0..100), DomainEnd=Slider(200, range=0..1000))
remap_3 = RemapNumbers(Value=dedomain_3.Start, Source=panel_3, Target=dom_3)  # -> Mapped, Clipped
Z_5 = UnitZ(Factor=remap_3.Mapped)
extr_5 = Extrude(Base=boundary_3, Direction=Z_5)
mesh_12 = MeshBrep(
    Brep=extr_5,
    Settings={GridMaxCount=0, GridMinCount=16, JaggedSeams=False, MaxEdgeLength=0, MinEdgeLength=0.0001, MinTolerance=0, Refine=True, RefineAngle=0, RelativeTolerance=0.65, SimplePlanes=True, Tolerance=0})
mcol_12 = MeshColours(Mesh=mesh_12, Colours=graft_6)

dom_4 = ConstructDomain(DomainStart=Slider(40, range=0..100), DomainEnd=Slider(200, range=0..1000))
remap_4 = RemapNumbers(Value=dedomain_8.Start, Source=panel_8, Target=dom_4)  # -> Mapped, Clipped
Z_6 = UnitZ(Factor=remap_4.Mapped)
extr_6 = Extrude(Base=boundary_5, Direction=Z_6)
mesh_13 = MeshBrep(
    Brep=extr_6,
    Settings={GridMaxCount=0, GridMinCount=16, JaggedSeams=False, MaxEdgeLength=0, MinEdgeLength=0.0001, MinTolerance=0, Refine=True, RefineAngle=0, RelativeTolerance=0.65, SimplePlanes=True, Tolerance=0})
mcol_13 = MeshColours(Mesh=mesh_13, Colours=graft_16)

dom_5 = ConstructDomain(DomainStart=Slider(20, range=0..100), DomainEnd=Slider(50, range=0..100))
remap_5 = RemapNumbers(Value=dedomain_4.Start, Source=panel_4, Target=dom_5)  # -> Mapped, Clipped
Z_7 = UnitZ(Factor=remap_5.Mapped)
extr_7 = Extrude(Base=boundary_4, Direction=Z_7)
mesh_14 = MeshBrep(
    Brep=extr_7,
    Settings={GridMaxCount=0, GridMinCount=16, JaggedSeams=False, MaxEdgeLength=0, MinEdgeLength=0.0001, MinTolerance=0, Refine=True, RefineAngle=0, RelativeTolerance=0.65, SimplePlanes=True, Tolerance=0})
mcol_14 = MeshColours(Mesh=mesh_14, Colours=graft_8)

dom_6 = ConstructDomain(DomainStart=Slider(80, range=0..100), DomainEnd=Slider(100, range=0..100))
remap_6 = RemapNumbers(Value=dedomain_5.Start, Source=panel_6, Target=dom_6)  # -> Mapped, Clipped
Z_8 = UnitZ(Factor=remap_6.Mapped)
extr_8 = Extrude(Base=boundary_6, Direction=Z_8)
mesh_15 = MeshBrep(
    Brep=extr_8,
    Settings={GridMaxCount=0, GridMinCount=16, JaggedSeams=False, MaxEdgeLength=0, MinEdgeLength=0.0001, MinTolerance=0, Refine=True, RefineAngle=0, RelativeTolerance=0.65, SimplePlanes=True, Tolerance=0})
mcol_15 = MeshColours(Mesh=mesh_15, Colours=graft_10)

dom_7 = ConstructDomain(DomainStart=Slider(10, range=0..10), DomainEnd=Slider(50, range=0..100))
remap_7 = RemapNumbers(Value=dedomain_7.Start, Source=panel_7, Target=dom_7)  # -> Mapped, Clipped
Z_9 = UnitZ(Factor=remap_7.Mapped)
extr_9 = Extrude(Base=boundary_7, Direction=Z_9)
mesh_16 = MeshBrep(
    Brep=extr_9,
    Settings={GridMaxCount=0, GridMinCount=16, JaggedSeams=False, MaxEdgeLength=0, MinEdgeLength=0.0001, MinTolerance=0, Refine=True, RefineAngle=0, RelativeTolerance=0.65, SimplePlanes=True, Tolerance=0})
mcol_16 = MeshColours(Mesh=mesh_16, Colours=graft_14)

dom_8 = ConstructDomain(DomainStart=Slider(70, range=0..100), DomainEnd=Slider(90, range=0..100))
remap_8 = RemapNumbers(Value=dedomain_6.Start, Source=panel_5, Target=dom_8)  # -> Mapped, Clipped
Z_10 = UnitZ(Factor=remap_8.Mapped)
extr_10 = Extrude(Base=boundary_8, Direction=Z_10)
mesh_17 = MeshBrep(
    Brep=extr_10,
    Settings={GridMaxCount=0, GridMinCount=16, JaggedSeams=False, MaxEdgeLength=0, MinEdgeLength=0.0001, MinTolerance=0, Refine=True, RefineAngle=0, RelativeTolerance=0.65, SimplePlanes=True, Tolerance=0})
mcol_17 = MeshColours(Mesh=mesh_17, Colours=graft_12)
